# Dynamo graph IslamicPattern_Example.dyn (Dynamo 4.1.0.3436)
# author: Morpho
# Example demonstrating Islamic pattern generation with Morpho
# packages: Morpho 1.0.0

# note: Islamic Star Pattern Example
byCoordinates = Point.ByCoordinates()
radius = DoubleSlider(50, range=10..100 step 5)  # graph input
star_points = IntegerSlider(8, range=3..16 step 1)  # graph input
inner_ratio = DoubleSlider(0.4, range=0.1..0.9 step 0.05)  # graph input
create = Morpho.Patterns.StarPolygon.Create(center=byCoordinates, radius=radius, points=star_points, innerRatio=inner_ratio)
