# Dynamo graph Fractal_Koch_Example.dyn (Dynamo 4.1.0.3436)
# author: Morpho
# Example demonstrating Koch and Sierpinski fractal generation with Morpho
# packages: Morpho 1.0.0

# note: Fractal Examples
byCoordinates = Point.ByCoordinates()
size = DoubleSlider(100, range=20..200 step 10)  # graph input
iterations = IntegerSlider(4, range=0..6 step 1)  # graph input
snowflake = Morpho.Patterns.Koch.Snowflake(center=byCoordinates, radius=size, iterations=iterations)
