# Dynamo graph LSystem_Tree_Example.dyn (Dynamo 4.0.0.0)
# author: Morpho
# Example demonstrating L-System tree generation with Morpho Python nodes

# note: L-System Tree Generator
preset = StringInput("tree")  # graph input
start_point = Point.ByCoordinates()
iterations = IntegerSlider(4, range=1..7 step 1)  # graph input
segment_length = DoubleSlider(10, range=1..20 step 1)  # graph input
length_decay = DoubleSlider(0.7, range=0.3..1 step 0.05)  # graph input
l_system_generator = Python(IN[0]=preset, IN[1]=start_point, IN[2]=iterations, IN[3]=segment_length, IN[4]=length_decay)  # CPython3
# ---------- l_system_generator.python (45 lines) ----------
# L-System Tree Generator using Morpho
# 
# This Python node uses the Morpho L-System library to generate
# procedural tree and plant structures.
#
# Inputs:
#   IN[0] - Preset name: "tree", "fern", "bush", "dragon", etc.
#   IN[1] - Start point (Point)
#   IN[2] - Iterations (int) - more = more detail but slower
#   IN[3] - Segment length (double)
#   IN[4] - Length decay (double) - how much branches shrink

import clr
clr.AddReference('ProtoGeometry')
from Autodesk.DesignScript.Geometry import Point

import sys
import os

# Add Morpho Python path
# Adjust this path to your Morpho package location
morpho_path = r'C:\Workspace\Github\Morpho\python'
if morpho_path not in sys.path:
    sys.path.append(morpho_path)

from morpho_lsystems import generate_2d, list_presets, PRESETS

# Get inputs with defaults
preset = IN[0] if IN[0] else "tree"
start_point = IN[1] if IN[1] else Point.ByCoordinates(0, 0, 0)
iterations = IN[2] if IN[2] else 4
length = IN[3] if IN[3] else 10
decay = IN[4] if IN[4] else 0.7

# Generate the L-System pattern
lines = generate_2d(
    preset_or_axiom=preset,
    start_point=start_point,
    iterations=iterations,
    length=length,
    length_decay=decay
)

# Output the lines and available presets
OUT = [lines, list_presets()]
# ----------------------------------------
